# Grasshopper definition void.gh (Grasshopper 1.0.7)
# plug-ins: VoxelTools

# ----
# x: slice coordinate,
# controlled by Python script
number_slider = Slider(1800, range=0..5000)

# ----
# Get instance GUID
ghpython_script = GhPythonScript(x=number_slider)  # -> out, a
# ---------- ghpython_script: Python ----------
__author__ = "zhuhu"
__version__ = "2025.06.19"

import rhinoscriptsyntax as rs
for input in ghenv.Component.Params.Input:
    for source in input.Sources:
        a = str(source.InstanceGuid)
# ---------- end ghpython_script ----------
panel = Panel(ghpython_script.a)

# ----
# 0 - Parametric modelling of the example model (void and pavements)
# Sand
# Sub-base
# Void
# Road base
number_slider_2 = Slider(0, range=0..4)
number_slider_3 = Slider(2000, range=0..200000)
number_slider_4 = Slider(2000, range=0..4000)
construct_point = ConstructPoint(XCoordinate=number_slider_3, YCoordinate=number_slider_4, ZCoordinate=number_slider_2)
number_slider_5 = Slider(2000, range=1..3000)
rectangle_2pt = Rectangle2Pt(Plane=PlaneXY(0, 0, 0), PointA=Point(0, 0, 0), PointB=construct_point, Radius=0)  # -> Rectangle, Length
number_slider_6 = Slider(2, range=1..5)
box_rectangle = BoxRectangle(Rectangle=rectangle_2pt.Rectangle, Height=number_slider_5)
custom_preview = CustomPreview(Geometry=box_rectangle, Material=ColourSwatch(SwatchColor=RGBA(219, 190, 173, 142)))
number_slider_7 = Slider(150, range=0..200)
number_slider_8 = Slider(65, range=0..200)
box_corners = BoxCorners(Box=box_rectangle)  # -> CornerA, CornerB, CornerC, CornerD, CornerE, CornerF, CornerG, CornerH
number_slider_9 = Slider(40, range=0..200)
number_slider_10 = Slider(175, range=0..200)
_4point_surface = _4PointSurface(CornerA=box_corners.CornerE, CornerB=box_corners.CornerF, CornerC=box_corners.CornerG, CornerD=box_corners.CornerH)
box_rectangle_2 = BoxRectangle(Rectangle=_4point_surface, Height=number_slider_7)
box_corners_2 = BoxCorners(Box=box_rectangle_2)  # -> CornerA, CornerB, CornerC, CornerD, CornerE, CornerF, CornerG, CornerH
_4point_surface_2 = _4PointSurface(
    CornerA=box_corners_2.CornerE,
    CornerB=box_corners_2.CornerF,
    CornerC=box_corners_2.CornerG,
    CornerD=box_corners_2.CornerH)
box_rectangle_3 = BoxRectangle(Rectangle=_4point_surface_2, Height=number_slider_10)
box_corners_3 = BoxCorners(Box=box_rectangle_3)  # -> CornerA, CornerB, CornerC, CornerD, CornerE, CornerF, CornerG, CornerH
_4point_surface_3 = _4PointSurface(
    CornerA=box_corners_3.CornerE,
    CornerB=box_corners_3.CornerF,
    CornerC=box_corners_3.CornerG,
    CornerD=box_corners_3.CornerH)
division = Division(A=number_slider_3, B=number_slider_6)
division_2 = Division(A=number_slider_5, B=number_slider_6)
division_3 = Division(A=number_slider_4, B=number_slider_6)
custom_preview_2 = CustomPreview(Geometry=box_rectangle_2, Material=ColourSwatch(SwatchColor=RGBA(150, 163, 182, 190)))
custom_preview_3 = CustomPreview(Geometry=box_rectangle_3, Material=ColourSwatch(SwatchColor=RGBA(124, 146, 189, 189)))
construct_point_2 = ConstructPoint(XCoordinate=division, YCoordinate=division_3, ZCoordinate=division_2)
sphere = Sphere(Base=construct_point_2, Radius=Slider(500, range=0..2000))

# ----
# Base course
colour_swatch = ColourSwatch(SwatchColor=RGBA(97, 123, 185, 190))
box_rectangle_4 = BoxRectangle(Rectangle=_4point_surface_3, Height=number_slider_8)
custom_preview_4 = CustomPreview(Geometry=box_rectangle_4, Material=colour_swatch)

addition = Addition(A=number_slider_5, B=number_slider_7, C=number_slider_10, D=number_slider_8, E=number_slider_9)

box_corners_4 = BoxCorners(Box=box_rectangle_4)  # -> CornerA, CornerB, CornerC, CornerD, CornerE, CornerF, CornerG, CornerH
_4point_surface_4 = _4PointSurface(
    CornerA=box_corners_4.CornerE,
    CornerB=box_corners_4.CornerF,
    CornerC=box_corners_4.CornerG,
    CornerD=box_corners_4.CornerH)

# ----
# Wearing course
colour_swatch_2 = ColourSwatch(SwatchColor=RGBA(70, 90, 168, 197))
box_rectangle_5 = BoxRectangle(Rectangle=_4point_surface_4, Height=number_slider_9)
custom_preview_5 = CustomPreview(Geometry=box_rectangle_5, Material=colour_swatch_2)

# ----
# 1. Specify parameters for slicing and voxelisation
height = Panel(addition)
# Slice width/mm
number_slider_11 = Slider(10, range=0..20)
# Voxel resolution/mm
number_slider_12 = Slider(10, range=0..40)
construct_point_3 = ConstructPoint(XCoordinate=number_slider, YCoordinate=Slider(0, range=0..3000), ZCoordinate=Slider(0, range=0..3000))
construct_plane = ConstructPlane(Origin=construct_point_3, XAxis=Vector(0, 0, 1), YAxis=Vector(0, 1, 0))
domain_box = DomainBox(Base=construct_plane, X=height, Y=number_slider_4, Z=number_slider_11)
create_voxelgrid = CreateVoxelGrid(BoundingBox=domain_box, SizeX=number_slider_12, SizeY=number_slider_12, SizeZ=number_slider_12)

# ----
# Void
# Sand
# Sub-base
# Road base
# Base course
# Wearing course
# 2. Select entities
brep = Brep(sphere)
brep_2 = Brep(box_rectangle)
brep_3 = Brep(box_rectangle_4)
brep_4 = Brep(box_rectangle_5)
brep_5 = Brep(box_rectangle_2)
brep_6 = Brep(box_rectangle_3)

# ----
# 3. Voxelise each entity for each slice
voxelategeometry = VoxelateGeometry(Geometry=brep, VoxelGrid=create_voxelgrid, Distance=0)
voxelategeometry_2 = VoxelateGeometry(Geometry=brep_2, VoxelGrid=create_voxelgrid, Distance=0)
voxelategeometry_3 = VoxelateGeometry(Geometry=brep_5, VoxelGrid=create_voxelgrid, Distance=0)
voxelategeometry_4 = VoxelateGeometry(Geometry=brep_6, VoxelGrid=create_voxelgrid, Distance=0)
voxelategeometry_5 = VoxelateGeometry(Geometry=brep_3, VoxelGrid=create_voxelgrid, Distance=0)
# Note: In the GhPython script (data2list) in Step 3, change the input type to 'Tree access' by right clicking the inputs
voxelategeometry_6 = VoxelateGeometry(Geometry=brep_4, VoxelGrid=create_voxelgrid, Distance=0)
voxelgrid_to_list = VoxelGridToList(Grids=voxelategeometry)  # -> flatten(Bool), Pts
voxelgrid_to_list_2 = VoxelGridToList(Grids=voxelategeometry_2)  # -> flatten(Bool), Pts
voxelgrid_to_list_3 = VoxelGridToList(Grids=voxelategeometry_3)  # -> flatten(Bool), Pts
voxelgrid_to_list_4 = VoxelGridToList(Grids=voxelategeometry_4)  # -> flatten(Bool), Pts
voxelgrid_to_list_5 = VoxelGridToList(Grids=voxelategeometry_5)  # -> flatten(Bool), Pts
voxelgrid_to_list_6 = VoxelGridToList(Grids=voxelategeometry_6)  # -> flatten(Bool), Pts
data2list = GhPythonScript(data=voxelgrid_to_list_6.Bool, identifier=Slider(6, range=0..6))  # -> out, a; inputs data: tree
# ---------- data2list: Python ----------
__author__ = "zhuhu"
__version__ = "2025.06.19"

import rhinoscriptsyntax as rs
"""Provides a scripting component.
    Inputs:
        x: The x script variable
        y: The y script variable
    Output:
        a: The a output variable"""

__author__ = "User"
__version__ = "2019.10.02"

import Rhino
from ghpythonlib import treehelpers as th
# requirements: numpy


# unpack data
flatten = []
data = th.tree_to_list(data)

#print type(data)
for dataList in data:
    dataList = int(dataList)*identifier
    flatten.append(int(dataList))

a = flatten
# ---------- end data2list ----------
data2list_2 = GhPythonScript(data=voxelgrid_to_list.Bool, identifier=Slider(1, range=0..6))  # -> out, a; inputs data: tree; same code as data2list
data2list_3 = GhPythonScript(data=voxelgrid_to_list_2.Bool, identifier=Slider(2, range=0..6))  # -> out, a; inputs data: tree; same code as data2list
data2list_4 = GhPythonScript(data=voxelgrid_to_list_3.Bool, identifier=Slider(3, range=0..6))  # -> out, a; inputs data: tree; same code as data2list
data2list_5 = GhPythonScript(data=voxelgrid_to_list_4.Bool, identifier=Slider(4, range=0..6))  # -> out, a; inputs data: tree; same code as data2list
data2list_6 = GhPythonScript(data=voxelgrid_to_list_5.Bool, identifier=Slider(5, range=0..6))  # -> out, a; inputs data: tree; same code as data2list

# ----
# 4. Output and save
division_4 = Division(A=number_slider, B=200)
text = Text(division_4)
ghpython_script_2 = GhPythonScript(L1=data2list_2.a, L2=data2list_3.a)  # -> out, a; inputs L1: tree, L2: tree
# ---------- ghpython_script_2: Python ----------
__author__ = "zhuhu"
__version__ = "2025.06.20"

import rhinoscriptsyntax as rs
from ghpythonlib import treehelpers as th

L1 = th.tree_to_list(L1)[0]
L2 = th.tree_to_list(L2)[0]

c = []
for a, b in zip(L1, L2):

    if a+b == 1:
        c.append(1)
    elif a+b == 2:
        c.append(2)
    elif a+b == 3:
        c.append(1)
    else:
        c.append(0)

a = c
# ---------- end ghpython_script_2 ----------
ghpython_script_3 = GhPythonScript(L12=ghpython_script_2.a, L3=data2list_4.a, L4=data2list_5.a, L5=data2list_6.a, L6=data2list.a)  # -> out, a; inputs L12: tree, L3: tree, L4: tree, L5: tree, L6: tree
# ---------- ghpython_script_3: Python ----------
__author__ = "zhuhu"
__version__ = "2025.06.20"

import rhinoscriptsyntax as rs
from ghpythonlib import treehelpers as th

L12 = th.tree_to_list(L12)[0]
L3 = th.tree_to_list(L3)[0]
L4 = th.tree_to_list(L4)[0]
L5 = th.tree_to_list(L5)[0]
L6 = th.tree_to_list(L6)[0]

merge = []
for a, b, c, d, e in zip(L12, L3, L4, L5, L6):
    print(a, b, c, d, e)
    if sum([a, b, c, d, e]) == 1:
        merge.append(1)
    elif sum([a, b, c, d, e]) == 2:
        merge.append(2)
    elif sum([a, b, c, d, e]) == 3:
        merge.append(3)
    elif sum([a, b, c, d, e]) == 4:
        merge.append(4)
    elif sum([a, b, c, d, e]) == 5:
        merge.append(5)
    elif sum([a, b, c, d, e]) == 6:
        merge.append(6)
# for some cases where 4 and 5 both appear
    elif sum([a, b, c, d, e]) == 9:
        merge.append(5)
    else:
        merge.append(0)

a = merge
# ---------- end ghpython_script_3 ----------
matrix = Panel(ghpython_script_3.a)
ghpython_script_4 = GhPythonScript(data=matrix, filepath="D:\C-SCAN\void\", filename=text, extension=".csv")  # -> out, a; inputs data: tree
# ---------- ghpython_script_4: Python ----------
__author__ = "zhuhu"
__version__ = "2025.06.23"

import csv
import rhinoscriptsyntax as rs
import Rhino
from ghpythonlib import treehelpers as th

# unpack data
#flatten = []
data = th.tree_to_list(data)[0]
#print data
#for dataList in data:
#    for item in dataList:
#        flatten.append(item)
        
# construct file full path
fullpath = filepath + filename + extension
print (fullpath)
for d in data:
    print(d)
# open / create new file
with open(fullpath, 'w') as file:
    
    # export methods for different extensions
    if extension == ".txt":
        file.writelines([d + "\n" for d in flatten])
    elif extension == ".csv":
        writer = csv.writer(file, lineterminator='\n')
        writer.writerows(d for d in data)
#        file.writelines(d for d in data)
    file.close()
# ---------- end ghpython_script_4 ----------
